# Grasshopper definition Loop-for-Dataset.gh (Grasshopper 1.0.8)
# plug-ins: Heteroptera, Pufferfish, Anemone, PTComponentLibrary, MetaHopper

number_slider = Slider(5, range=0..10)

# ----
# Loop Start
button = Button()
number_slider_2 = Slider(662, range=0..1000)
loop_start = LoopStart(Repeat=Slider(180, range=0..10000), Trigger=button, Data=number_slider_2)  # -> port, Counter, flatten(Data)

rec = DataRecorder(loop_start.Counter, DataLimit=-10, RecordData=True)
rec_2 = DataRecorder(loop_start.Data, DataLimit=-10, RecordData=True)
number_slider_3 = Slider(1, range=0..10)  # disabled
panel = Panel(rec)
panel_2 = Panel(rec_2)

swatch = ColourSwatch(SwatchColor=RGBA(255, 0, 153, 179))  # disabled
swatch_2 = ColourSwatch(SwatchColor=RGBA(0, 72, 255, 179))  # disabled
swatch_3 = ColourSwatch(SwatchColor=RGBA(255, 196, 0, 179))  # disabled
# SELF-MORPHING SIMULATOR
swatch_4 = ColourSwatch(SwatchColor=RGBA(191, 194, 201, 201))  # disabled
setgroup = SetGroupProperties(
    Group=["Grasshopper.Kernel.Types.GH_ObjectWrapper", "Grasshopper.Kernel.Types.GH_ObjectWrapper", "Grasshopper.Kernel.Types.GH_ObjectWrapper", "Grasshopper.Kernel.Types.GH_ObjectWrapper", "Grasshopper.Kernel.Types.GH_ObjectWrapper"],
    Color=swatch)  # disabled

# ---- group: Shrinkage Amounts
thickness = Slider(0.32, range=0.2..0.5)

# ---- group: Basic Shape Inputs
list = ValueList({"Plate": 0, "Ribbon": 1, "Free-Form": 2}, selected="Ribbon")
list_2 = ValueList({"Pixelization": 0, "Adaptive Pattern": 1}, selected="Pixelization")
free_form_curve = Curve(<curve referenced from the Rhino model>)

surface_x_size = Slider(30, range=1..100)
surface_y_size = Slider(40, range=1..101)

# ---- group: Attractor points bounds
number_slider_4 = Slider(1, range=0..1)  # disabled
a_b_x = Multiplication(A=surface_x_size, B=number_slider_3)  # disabled
a_b_y = Multiplication(A=surface_y_size, B=number_slider_3)  # disabled
x_recommended_number_for_slider = Panel(a_b_x)  # disabled
y_recommended_number_for_slider = Panel(a_b_y)  # disabled
number_slider_5 = Slider(0, range=0..10)  # disabled

# ---- group: Basic Shape Inputs
number_of_columns = Slider(1, range=1..10)
number_of_rows = Slider(1, range=1..10)

# ----
number_slider_6 = Slider(180, range=0..1000)  # disabled
# Insert Fiber Orientation
multiplication = Multiplication(A=number_of_columns, B=number_of_rows)  # disabled
genes = GenePool(Decimals=0, Maximum=180, Minimum=0, Value=[45, 90, 90])  # disabled
pool_controller = GenePoolController(GenePool=genes, Count=multiplication, Range=number_slider_6, Decimal=0, Randomness=0.1)  # disabled

# ---- group: Shrinkage Amounts
fiber_shrinkage_factor_top = Slider(1, range=0..1.1)
matrix_shrinkage_factor_top = Slider(0.976, range=0..1)

fiber_shrinkage_factor_bottom = Slider(1, range=0..1.1)
matrix_shrinkage_factor_bottom = Slider(0.977, range=0..1)

# ----
# Loop
# Random Matrix
number_slider_7 = Slider(1, range=0..100)
python_top_random_gal = GhPythonScript(increment=number_slider_7, num_rows=number_of_rows, num_cols=number_of_columns, seed=loop_start.Data)  # -> flatten(result_lst), seed; disabled
# ---------- python_top_random_gal: Python ----------
"""Provides a scripting component.
    Inputs:
        increment: increment of degrees to use

    Output:
        result_list: array of numbers between 0-180 in increments by iput"""

__author__ = "user"
__version__ = "2023.11.01"

import rhinoscriptsyntax as rs
import ghpythonlib.treehelpers as th
import random


random.seed(seed)

list_of_possible_angles = []
result_lst = []

num = 0

while num < 180:
    list_of_possible_angles.append(num)
#    print("loop ", num)
    num = int(num + increment)


num_pixels=int(num_rows*num_cols)
print(num_pixels)

for pixel in range(num_pixels):
    i =random.randint(0,len(list_of_possible_angles)-1)
    angle = list_of_possible_angles[i]
    result_lst.append(angle)

print(result_lst)
# ---------- end python_top_random_gal ----------
random_fiber_orientations = Panel(python_top_random_gal.result_lst)

number_slider_8 = Slider(16, range=0..100)  # disabled

# ---- group: Create attractors between points
neg = Negative(Value=x_recommended_number_for_slider)  # disabled
neg_2 = Negative(Value=y_recommended_number_for_slider)  # disabled
neg_3 = Negative(Value=number_slider_5)  # disabled
number_slider_9 = Slider(1, range=0..10)  # disabled
number_slider_10 = Slider(4, range=0..10)  # disabled
dom = ConstructDomain(DomainStart=neg, DomainEnd=x_recommended_number_for_slider)  # disabled
dom_2 = ConstructDomain(DomainStart=neg_2, DomainEnd=y_recommended_number_for_slider)  # disabled
dom_3 = ConstructDomain(DomainStart=neg_3, DomainEnd=number_slider_5)  # disabled
py3 = Python3Script(
    seed=loop_start.Data,
    x_bounds=dom,
    y_bounds=dom_2,
    z_bounds=dom_3,
    min_points=number_slider_9,
    max_points=number_slider_10)  # -> flatten(num_points), points; inputs min_points: Int32, max_points: Int32; disabled
# ---------- py3: Python ----------
import random
import rhinoscriptsyntax as rs

random.seed(seed)
def generate_random_points(num_points, x_bounds, y_bounds, z_bounds):
    points = []
    for _ in range(num_points):
        x = round(random.uniform(x_bounds[0], x_bounds[1]), 2)
        y = round(random.uniform(y_bounds[0], y_bounds[1]), 2)
        z = round(random.uniform(z_bounds[0], z_bounds[1]), 2)
        point = rs.CreatePoint(x, y, z)
        points.append(point)
    return points


num_points= random.randint(min_points, max_points)

# Generate the random points
points = generate_random_points(num_points, x_bounds, y_bounds, z_bounds)

print(num_points)
# ---------- end py3 ----------

# ---- group: Simulation Parameters / Fiber Factors
axialfiber = Slider(40, range=0..50)
bendingfiber = Slider(10, range=0..50)

# ---- group: Simulation Parameters / Matrix Factors
axialmatrix = Slider(50, range=0..100)
bendingmatrix = Slider(10, range=0..50)

# ---- group: Simulation Parameters / Web Factors
axialweb = Slider(100, range=0..1000)
bendingweb = Slider(50, range=0..50)

# ---- group: Solver Parameters
pattern_scale = Slider(12, range=4..20)
threshold_factor_10_x = Slider(12, range=8..20)
tolerance_factor_10_x = Slider(6, range=1..20)

# ----
dots = DotDisplay(Point=py3.points, Colour=RGB(0, 0, 0), Size=1)  # disabled
connect_angles = Number(loop_start.Counter)

# ---- group: Final Fiber Orientation
connect_fiber_orientation_here = Panel(connect_angles)
addition = Addition(A=connect_fiber_orientation_here, B=Slider(90, range=0..100))
_90_to_everythin = Panel(addition)
num = Number(connect_fiber_orientation_here)
num_2 = Number(_90_to_everythin)

# ---- group: Cluster Inputs
srfxsize = Number(surface_x_size)
thickness_2 = Number(thickness)
srfysize = Number(surface_y_size)
pattern_values_top = Number(simplify(graft(num)))
pattern_values_bottom = Number(simplify(graft(num_2)))

# ---- group: Build Mesh
dom_4 = ConstructDomain(DomainStart=expr("-x/2", srfxsize), DomainEnd=expr("x/2", srfxsize))
dom_5 = ConstructDomain(DomainStart=expr("-x/2", srfysize), DomainEnd=expr("x/2", flatten(srfysize)))
boundary = BoundarySurfaces(FreeFormCrv=free_form_curve)
cir = Circle(Plane=PlaneXY(0, 0, 0), Radius=expr("x/2", srfxsize))
planesrf1 = PlaneSurface(Plane=PlaneXY(0, 0, 0), XSize=dom_4, YSize=dom_5)
boundary_2 = BoundarySurfaces(Edges=cir)
filter = StreamFilter(BaseShapeIdx=list, Stream0=boundary_2, Stream1=planesrf1, Stream2=boundary)
srf = Surface(filter)
Z = UnitZ(Thickness=thickness_2)
gate = StreamGate(Stream=srf, Gate=0)  # -> Target0, Target1

# ---- group: Grid
brec = BoundingRectangle(Geometry=srf, Plane=PlaneXY(0, 0, 0), Axis=0, Slide=0, Union=True)  # -> Bounding, DimensionX, DimensionY
pt = ConstructPoint(XCoordinate=expr("-x/2", brec.DimensionX), YCoordinate=expr("-x/2", brec.DimensionY), ZCoordinate=0)
division = Division(A=brec.DimensionX, B=number_of_columns)
division_2 = Division(A=brec.DimensionY, B=number_of_rows)
recgrid = Rectangular(Plane=pt, SizeX=division, SizeY=division_2, ExtentX=number_of_columns, ExtentY=number_of_rows)  # -> flatten(Cells), flatten(Points)

# ----
area_patches = Area(Geometry=recgrid.Cells)  # -> Area, graft(Centroid); disabled

# ---- group: get distance
dist = Distance(PointA=area_patches.Centroid, PointB=py3.points)  # disabled
number_of_attraction_points = Panel(py3.num_points)  # disabled
ma = MassAddition(Input=dist)  # -> Result, PartialResults; disabled
division_3 = Division(A=ma.Result, B=number_of_attraction_points)  # -> flatten(Result); disabled

# ---- group: remap
number_slider_11 = Slider(10, range=0..100)  # disabled
number_slider_12 = Slider(30, range=0..100)  # disabled
number_slider_13 = Slider(0, range=0..100)  # disabled
number_slider_14 = Slider(180, range=0..1000)  # disabled
dom_6 = ConstructDomain(DomainStart=number_slider_11, DomainEnd=number_slider_12)  # disabled
dom_7 = ConstructDomain(DomainStart=number_slider_13, DomainEnd=number_slider_14)  # disabled
remap = RemapNumbers(Value=division_3, Source=dom_6, Target=dom_7)  # -> flatten(Mapped), Clipped; disabled
panel_3 = Panel(remap.Mapped)  # disabled

# ----
bnd = Bounds(Numbers=flatten(division_3))  # disabled
dedomain = DeconstructDomain(Domain=bnd)  # -> Start, End; disabled
panel_4 = Panel(dedomain.Start)  # disabled
panel_5 = Panel(dedomain.End)  # disabled
# Attractor Points
current_bounds = Panel(bnd)  # disabled

# ---- group: round
panel_6 = Panel(number_slider_7)  # disabled
roundf = RoundToFactor(NumberX=panel_3, Factor=panel_6, RoundType=0)  # -> Rounded, Difference, MultiplierR, MultiplierX; disabled
panel_7 = Panel(roundf.Rounded)  # disabled

# ---- group: Attractor points but MULTIPICATIONS AND SINUS
mm = MassMultiplication(Input=dist)  # -> flatten(Result), PartialResults; disabled
bnd_2 = Bounds()  # disabled
sin = Sine(Value=mm.Result)  # disabled
current_bounds_2 = Panel(bnd_2)  # disabled
panel_8 = Panel(sin)  # disabled
number_slider_15 = Slider(-1, range=-10..10)  # disabled
number_slider_16 = Slider(1, range=-10..10)  # disabled
dom_8 = ConstructDomain(DomainStart=number_slider_15, DomainEnd=number_slider_16)  # disabled
remap_2 = RemapNumbers(Value=panel_8, Source=dom_8, Target=dom_7)  # -> flatten(Mapped), Clipped; disabled
panel_9 = Panel(remap_2.Mapped)  # disabled
roundf_2 = RoundToFactor(NumberX=panel_9, Factor=panel_6, RoundType=0)  # -> Rounded, Difference, MultiplierR, MultiplierX; disabled
panel_10 = Panel(roundf_2.Rounded)  # disabled

# ----
tag = TextTag(Location=flatten(area_patches.Centroid), Text=panel_7)  # disabled

remove_outliers = Python3Script(list_of_angles=panel_7)  # -> out_list_of_angles; inputs list_of_angles: list of Int32; disabled
# ---------- remove_outliers: Python ----------
"""Grasshopper Script"""

out_list_of_angles=[]
angles_changed = []

for angle in list_of_angles:
    #print(angle)
    if angle>=180:
        angle = angle-180
        if angle >= 180:
            angle = 179
    elif angle<0:
        angle = angle+180
        if angle<0:
            angle = 0
    out_list_of_angles.append(angle)


#print(out_list_of_angles)
# ---------- end remove_outliers ----------
panel_11 = Panel(remove_outliers)  # disabled

boundry = Curve(brec.Bounding)
gate_cluster = GateCluster(
    G_6=list_2,
    _0_6=recgrid.Cells,
    G=list_2,
    _0=pattern_values_top,
    G_2=list_2,
    _0_2=pattern_values_bottom,
    G_3=list_2,
    _0_3=number_of_rows,
    G_4=list_2,
    _0_4=number_of_columns,
    G_5=list_2,
    _0_5=brec.Bounding)  # -> s_0_6, s_0, s_0_2, s_0_3, s_0_4, s_0_5

# ---- group: Bottom Layer Processing / Moves layer according to thickness
Z_2 = UnitZ(Factor=expr("-x/2", thickness_2))
move_bottom = Move(Geometry=gate_cluster.s_0_6, Motion=Z_2)  # -> Geometry, Transform

# ---- group: Top Layer Processing / Moves layer according to thickness
Z_3 = UnitZ(Factor=expr("x/2", thickness_2))
move_top = Move(Geometry=gate_cluster.s_0_6, Motion=Z_3)  # -> Geometry, Transform

# ---- group: Matrix Strengh
number_slider_17 = Slider(0, range=0..100)
num_3 = Number(axialmatrix)
subtraction = Subtraction(A=num_3, B=number_slider_17)
addition_2 = Addition(A=num_3, B=number_slider_17)
dom_9 = ConstructDomain(DomainStart=addition_2, DomainEnd=subtraction)

# ---- group: Sample Points / Sample Points Input
sdivide = DivideSurface(Surface=gate_cluster.s_0_5, UCount=surface_x_size, VCount=surface_y_size)  # -> Points, Normals, Parameters

# ---- group: Top Layer Processing
expression = Expression(x=gate_cluster.s_0, Expression="(x+90)%180")
hatchtopfiber = GhPythonScript(
    n_rows=gate_cluster.s_0_3,
    n_cols=gate_cluster.s_0_4,
    boundaries=move_top.Geometry,
    scale=pattern_scale,
    angles=gate_cluster.s_0)  # -> out, boundary_curves, pattern, scale, angles, names, news, geos; inputs boundaries: list of Curve, angles: list
# ---------- hatchtopfiber: Python ----------
__author__ = "Yitzchak Vaknin"
__version__ = "2023.08.31"

import Rhino.Geometry as rg
import Rhino as rh
import rhinoscriptsyntax as rs
import Grasshopper as gh
import scriptcontext as sc
import inspect
import math

#hatche patterns:
hatches = ["Solid","Single Line","Double Line",
"Triple Line","Dashed Line",
"Square Grid","Triangle Grid",
"Plus Grid", "Squares"]


def listToTree(nestedList):
    """Convert a nested python iterable to a datatree."""
    dt = gh.DataTree[object]()
    for i,l in enumerate(nestedList):
        dt.AddRange(l,gh.Kernel.Data.GH_Path(i))
    return dt

def listToTree_2D(nestedList):
    """Convert a nested python iterable to a datatree."""
    dt = gh.DataTree[object]()
    for i,l in enumerate(nestedList):
        for j,val in enumerate(l):
            dt.AddRange(val,gh.Kernel.Data.GH_Path(i))
    return dt

def HatchInfo(rows, cols):
    sc.doc = rh.RhinoDoc.ActiveDoc
    pattern = 1
    hname = hatches[pattern]
    geos = list()
    news = list()
    # iterate on cells:
    for i in range(0, int(rows*cols)):
        local_boundary_curves = list()
        local_geos = list()
        new = rg.Hatch.Create(boundaries[i], pattern, math.radians(angles[i]), scale)
        news.append(new)
        for j, n in enumerate(new):
            g = rg.Hatch.CreateDisplayGeometry(n, rh.DocObjects.HatchPattern.Defaults.Hatch1, 1)
            local_geos.append(g[1])
        geos.append(local_geos)
    geos = listToTree_2D(geos)
    return boundaries, pattern, scale, angles, hname, news, geos

boundary_curves, pattern, scale, angles, names, news, geos = HatchInfo(n_rows, n_cols)
# ---------- end hatchtopfiber ----------
hatchtopmatrix = GhPythonScript(
    n_rows=gate_cluster.s_0_3,
    n_cols=gate_cluster.s_0_4,
    boundaries=move_top.Geometry,
    scale=pattern_scale,
    angles=expression)  # -> out, boundary_curves, pattern, scale, angles, names, news, geos; inputs boundaries: list of Curve, angles: list; same code as hatchtopfiber
merge = Merge(Data1=hatchtopfiber.geos, Data2=hatchtopmatrix.geos)

# ---- group: Bottom Layer Processing
expression_2 = Expression(x=gate_cluster.s_0_2, Expression="(x+90)%180")
hatchbotfiber = GhPythonScript(
    n_rows=gate_cluster.s_0_3,
    n_cols=gate_cluster.s_0_4,
    boundaries=move_bottom.Geometry,
    scale=pattern_scale,
    angles=expression_2)  # -> out, boundary_curves, pattern, scale, angles, names, news, geos; inputs boundaries: list of Curve, angles: list; same code as hatchtopfiber
hatchbotfiber_2 = GhPythonScript(
    n_rows=gate_cluster.s_0_3,
    n_cols=gate_cluster.s_0_4,
    boundaries=move_bottom.Geometry,
    scale=pattern_scale,
    angles=gate_cluster.s_0_2)  # -> out, boundary_curves, pattern, scale, angles, names, news, geos; inputs boundaries: list of Curve, angles: list; same code as hatchtopfiber
merge_2 = Merge(Data1=hatchbotfiber_2.geos, Data2=hatchbotfiber.geos)

# ----
ptcenter = CenterGrid(Grid=sdivide.Points)

# ---- group: Sample Points / accuracy of sample points depends on this
number_slider_18 = Slider(10, range=0..10)

# ---- group: Frame Intersection
explode = Explode(Curve=simplify(graft(hatchtopfiber.boundary_curves)), Recursive=True)  # -> flatten(Segments), Vertices
python = GhPythonScript(boundary_lines=explode.Segments)  # -> filtered_boundaries; inputs boundary_lines: list of Curve
# ---------- python: Python ----------
__author__ = "Yitzchak Vaknin"
__version__ = "2023.02.26"

import rhinoscriptsyntax as rs

def filter_duplicate_boundaries(boundary_lines):
    filtered_boundaries = dict()
    for j, frame_line in enumerate(boundary_lines):
        edges = [rs.CurveStartPoint(frame_line), rs.CurveEndPoint(frame_line)]
        sorted_edges = sorted(edges, key=lambda x: (x[0], x[1]))
        frame_key = str(sorted_edges[0]) + "_" + str(sorted_edges[1])
#        print("frame line number {}, {}".format(j, frame_key))
        if frame_key not in filtered_boundaries:
            filtered_boundaries[frame_key] = frame_line
    return list(filtered_boundaries.values())

filtered_boundaries = filter_duplicate_boundaries(boundary_lines)
# ---------- end python ----------
python_2 = GhPythonScript(boundaries=python, pattern_lines=flatten(merge))  # -> intersection_pts; inputs boundaries: list of Curve, pattern_lines: list of Curve
# ---------- python_2: Python ----------
__author__ = "Yitzchak Vaknin"
__version__ = "2023.02.11"

import rhinoscriptsyntax as rs
import Grasshopper as gh

def listToTree(nestedList):
    """Convert a nested python iterable to a datatree."""
    dt = gh.DataTree[object]()
    for i,l in enumerate(nestedList):
        dt.AddRange(l,gh.Kernel.Data.GH_Path(i))
    return dt

def listToTree_2D(nestedList):
    """Convert a nested python iterable to a datatree."""
    dt = gh.DataTree[object]()
    for i,l in enumerate(nestedList):
        for j,val in enumerate(l):
            dt.AddRange(val,gh.Kernel.Data.GH_Path(i))
    return dt

def ccx_old(boundary, pattern_lines):
#    boundary_ctrl_pts = rs.CurvePoints(boundary)
    splited_lines = rs.ExplodeCurves(boundary)
    intersection_pts = list()
    for j, frame_line in enumerate(splited_lines):
        print("frame line number {}, {}".format(j, frame_line))
        local_intersection_pts = list()
        start = rs.CurveStartPoint(frame_line)
        local_intersection_pts.append(start)
        for i, pattern_line in enumerate(pattern_lines):
            print("pattern line number {}, {}".format(i, pattern_line))
            intersection_list = rs.CurveCurveIntersection(frame_line, pattern_line)
            if intersection_list is None:
                print "Selected curves do not intersect."
            else:
                for intersection in intersection_list:
                    local_intersection_pts.append(intersection[1])
                    if intersection[0] == 1:
                        print "Point"
                        print "Intersection point on first curve: ", intersection[1]
                        print "Intersection point on second curve: ", intersection[3]
                        print "First curve parameter: ", intersection[5]
                        print "Second curve parameter: ", intersection[7]
                    else:
                        print "Overlap"
                        print "Intersection start point on first curve: ", intersection[1]
                        print "Intersection end point on first curve: ", intersection[2]
                        print "Intersection start point on second curve: ", intersection[3]
                        print "Intersection end point on second curve: ", intersection[4]
                        print "First curve parameter range: ", intersection[5], " to ", intersection[6]
                        print "Second curve parameter range: ", intersection[7], " to ", intersection[8]
        intersection_pts.append(local_intersection_pts)
    return intersection_pts
#    return intersection_pts, splited_lines

def ccx_test(boundary, pattern_lines):
    intersection_pts = list()
    for j, frame_line in enumerate(boundary):
#        print("frame line number {}, {}".format(j, frame_line))
        local_intersection_pts = list()
        start = rs.CurveStartPoint(frame_line)
        local_intersection_pts.append(start)
        for i, pattern_line in enumerate(pattern_lines):
#            print("pattern line number {}, {}".format(i, pattern_line))
            intersection_list = rs.CurveCurveIntersection(frame_line, pattern_line)
            if intersection_list is None:
                x = 1
#                print "Selected curves do not intersect."
            else:
                for intersection in intersection_list:
                    local_intersection_pts.append(intersection[1])
#                    if intersection[0] == 1:
#                        print "Point"
#                        print "Intersection point on first curve: ", intersection[1]
#                        print "Intersection point on second curve: ", intersection[3]
#                        print "First curve parameter: ", intersection[5]
#                        print "Second curve parameter: ", intersection[7]
#                    else:
#                        print "Overlap"
#                        print "Intersection start point on first curve: ", intersection[1]
#                        print "Intersection end point on first curve: ", intersection[2]
#                        print "Intersection start point on second curve: ", intersection[3]
#                        print "Intersection end point on second curve: ", intersection[4]
#                        print "First curve parameter range: ", intersection[5], " to ", intersection[6]
#                        print "Second curve parameter range: ", intersection[7], " to ", intersection[8]
        intersection_pts.append(local_intersection_pts)
    return intersection_pts

def ccx(boundary_lines, pattern_lines):
    intersection_pts = dict()
    for j, frame_line in enumerate(boundary_lines):
        frame_key = str(rs.CurveStartPoint(frame_line)) + "_" + str(rs.CurveEndPoint(frame_line))
        print("frame line number {}, {}".format(j, frame_key))
        local_intersection_pts = list()
#        start = rs.CurveStartPoint(frame_line)
        local_intersection_pts.append(start)
        for i, pattern_line in enumerate(pattern_lines):
#            print("pattern line number {}, {}".format(i, pattern_line))
            intersection_list = rs.CurveCurveIntersection(frame_line, pattern_line)
            if intersection_list is None:
                print "Selected curves do not intersect."
            else:
                for intersection in intersection_list:
                    local_intersection_pts.append(intersection[1])
                    if intersection[0] == 1:
                        print "Point"
                        print "Intersection point on first curve: ", intersection[1]
                        print "Intersection point on second curve: ", intersection[3]
                        print "First curve parameter: ", intersection[5]
                        print "Second curve parameter: ", intersection[7]
                    else:
                        print "Overlap"
                        print "Intersection start point on first curve: ", intersection[1]
                        print "Intersection end point on first curve: ", intersection[2]
                        print "Intersection start point on second curve: ", intersection[3]
                        print "Intersection end point on second curve: ", intersection[4]
                        print "First curve parameter range: ", intersection[5], " to ", intersection[6]
                        print "Second curve parameter range: ", intersection[7], " to ", intersection[8]
        intersection_pts.append(local_intersection_pts)
    return intersection_pts

intersection_pts = listToTree(ccx_test(boundaries, pattern_lines))
# ---------- end python_2 ----------

# ---- group: Zipper
explode_2 = Explode(Curve=simplify(graft(hatchbotfiber_2.boundary_curves)), Recursive=True)  # -> flatten(Segments), Vertices
python_3 = GhPythonScript(boundary_lines=explode_2.Segments)  # -> filtered_boundaries; inputs boundary_lines: list of Curve; same code as python
python_4 = GhPythonScript(boundaries=python_3, pattern_lines=flatten(merge_2))  # -> intersection_pts; inputs boundaries: list of Curve, pattern_lines: list of Curve; same code as python_2

# ---- group: Fiber-Matrix Intersection
python_5 = GhPythonScript(fiber_lines=hatchtopfiber.geos, matrix_lines=hatchtopmatrix.geos)  # -> fiber_intersection_pts, matrix_intersection_pts; inputs fiber_lines: list of Curve, matrix_lines: list of Curve
# ---------- python_5: Python ----------
__author__ = "Yitzchak Vaknin"
__version__ = "2023.02.11"

import rhinoscriptsyntax as rs
import Grasshopper as gh
import copy
import ghpythonlib.treehelpers as th

def listToTree(nestedList):
    """Convert a nested python iterable to a datatree."""
    dt = gh.DataTree[object]()
    for i,l in enumerate(nestedList):
        dt.AddRange(l,gh.Kernel.Data.GH_Path(i))
    return dt

def listToTree_2D(nestedList):
    """Convert a nested python iterable to a datatree."""
    dt = gh.DataTree[object]()
    for i,l in enumerate(nestedList):
        print(i)
        for j,val in enumerate(l):
            dt.AddRange(val, gh.Kernel.Data.GH_Path(i, j))
    return dt

def ccx_matrix(fiber_lines, matrix_lines):
    intersection_pts_cycle = list()
    intersection_pts = list()
    for j, matrix_line in enumerate(matrix_lines):
        curve_intersection_pts = list()
        for i, fiber_line in enumerate(fiber_lines):
            intersection_list = rs.CurveCurveIntersection(matrix_line, fiber_line)
            if intersection_list is None:
                x = 1
            else:
                for intersection in intersection_list:
                    curve_intersection_pts.append(intersection[1])
        intersection_pts.append(curve_intersection_pts)
    intersection_pts_cycle.append(copy.copy(intersection_pts))
    for _ in range(len(intersection_pts)):
        intersection_pts.pop(0)
    return intersection_pts_cycle[0]

def ccx_fiber(fiber_lines, matrix_lines):
    intersection_pts_cycle = list()
    intersection_pts = list()
    for i, fiber_line in enumerate(fiber_lines):
        curve_intersection_pts = list()
        for j, matrix_line in enumerate(matrix_lines):
            intersection_list = rs.CurveCurveIntersection(matrix_line, fiber_line)
            if intersection_list is None:
                x = 1
            else:
                for intersection in intersection_list:
                    curve_intersection_pts.append(intersection[1])
        intersection_pts.append(curve_intersection_pts)
    intersection_pts_cycle.append(copy.copy(intersection_pts))
    for _ in range(len(intersection_pts)):
        intersection_pts.pop(0)
    return intersection_pts_cycle[0]
#intersection_pts = th.list_to_tree(ccx_matrix(fiber_lines, matrix_lines)[0])
#th.list_to_tree()
#print(len(intersection_pts[0]))
fiber_intersection_pts = ccx_fiber(fiber_lines, matrix_lines)
matrix_intersection_pts = ccx_matrix(fiber_lines, matrix_lines)
# ---------- end python_5 ----------
graft = GraftTree(Tree=hatchtopmatrix.geos, IncludeEmptyLists=True, IncludeNullItems=True)
c_script = CSharpScript(x=python_5.matrix_intersection_pts)  # -> A
# ---------- c_script: C# ----------
    A = x;
# ---------- end c_script ----------
graft_2 = GraftTree(Tree=hatchtopfiber.geos, IncludeEmptyLists=True, IncludeNullItems=True)
c_script_2 = CSharpScript(x=python_5.fiber_intersection_pts)  # -> A; same code as c_script
crv_cp = CurveClosestPoint(Point=c_script, Curve=graft)  # -> Point, Parameter, Distance
crv_cp_2 = CurveClosestPoint(Point=c_script_2, Curve=graft_2)  # -> Point, Parameter, Distance
shatter = Shatter(Curve=graft, Parameters=crv_cp.Parameter)  # -> simplify(Segments)
shatter_2 = Shatter(Curve=graft_2, Parameters=crv_cp_2.Parameter)  # -> simplify(Segments)

# ---- group: Bottom Layer Processing / Fiber-Matrix Intersection
python_6 = GhPythonScript(fiber_lines=hatchbotfiber_2.geos, matrix_lines=hatchbotfiber.geos)  # -> fiber_intersection_pts, matrix_intersection_pts; inputs fiber_lines: list of Curve, matrix_lines: list of Curve; same code as python_5
graft_3 = GraftTree(Tree=hatchbotfiber.geos, IncludeEmptyLists=True, IncludeNullItems=True)
c_script_3 = CSharpScript(x=python_6.matrix_intersection_pts)  # -> A; same code as c_script
graft_4 = GraftTree(Tree=hatchbotfiber_2.geos, IncludeEmptyLists=True, IncludeNullItems=True)
c_script_4 = CSharpScript(x=python_6.fiber_intersection_pts)  # -> A; same code as c_script
crv_cp_3 = CurveClosestPoint(Point=c_script_3, Curve=graft_3)  # -> Point, Parameter, Distance
crv_cp_4 = CurveClosestPoint(Point=c_script_4, Curve=graft_4)  # -> Point, Parameter, Distance
shatter_3 = Shatter(Curve=graft_3, Parameters=crv_cp_3.Parameter)  # -> simplify(Segments)
shatter_4 = Shatter(Curve=graft_4, Parameters=crv_cp_4.Parameter)  # -> simplify(Segments)

# ----
mat_top = Curve(shatter)
mat_bot = Curve(shatter_3)

# ---- group: Mat Strength
map_shrinkage = MapShrinkage(curve=mat_top, curve_2=boundry, target=dom_9)

# ---- group: Mat Strengh
map_shrinkage_2 = MapShrinkage(curve=mat_bot, curve_2=boundry, target=dom_9)

# ---- group: Middle Mesh
removeduplicatepoints = GhPythonScript(x=flatten(python_2))  # -> pts; inputs x: list of Point3d
# ---------- removeduplicatepoints: Python ----------
__author__ = "Yitzchak Vaknin"
__version__ = "2023.09.10"

import rhinoscriptsyntax as rs

def filter_duplicate_points(pts_lst):
    filtered_pts = dict()
    for i, pt in enumerate(pts_lst):
        pt_key = str(pt[0]) + "_" + str(pt[1]) + "_" + str(pt[2])
        if pt_key not in filtered_pts:
            filtered_pts[pt_key] = pt
    return list(filtered_pts.values())

pts = filter_duplicate_points(x)
# ---------- end removeduplicatepoints ----------
removeduplicatepoints_2 = GhPythonScript(x=flatten(python_4))  # -> pts; inputs x: list of Point3d; same code as removeduplicatepoints
pt_2 = Point(flatten([removeduplicatepoints, crv_cp_2.Point]))
pt_3 = Point(flatten([removeduplicatepoints_2, crv_cp_4.Point]))
cps = ClosestPoints(Point=flatten(pt_3), Cloud=flatten(pt_2), Count=Slider(10, range=0..10))  # -> simplify(ClosestPoint), CPIndex, Distance
ln = Line(StartPoint=simplify(graft(pt_3)), EndPoint=cps.ClosestPoint)  # -> flatten(Line)

# ---- group: Sample Points
srf_cp = SurfaceClosestPoint(Point=ptcenter, Surface=brec.Bounding)  # -> Point, UVPoint, Distance
pt_4 = Point([pt_2, pt_3])
cps_2 = ClosestPoints(Point=flatten(ptcenter), Cloud=flatten(pt_4), Count=number_slider_18)  # -> simplify(ClosestPoint), CPIndex, Distance
ln_2 = Line(StartPoint=simplify(graft(ptcenter)), EndPoint=cps_2.ClosestPoint)
rodbotzipper = Rod(
    Polyline=ln_2,
    LengthFactor=1,
    AngleFactor=1,
    AxialStrength=Slider(0.001, range=0..1),
    BendStrength=Slider(0.001, range=0..50))

# ---- group: Floor
scale = Scale(Geometry=gate_cluster.s_0_5, Center=Point(0, 0, 0), Factor=Slider(2, range=-10..10))  # -> Geometry, Transform
dom_10 = ConstructDomain(DomainStart=Slider(-10, range=-10..10), DomainEnd=Slider(0, range=-10..10))
merge_3 = Merge(Data1=crv_cp_2.Point, Data2=crv_cp.Point, Data3=cps.ClosestPoint, Data4=pt_2, Data5=crv_cp_4.Point, Data6=crv_cp_3.Point)  # -> flatten(Result)
boxrec = BoxRectangle(Rectangle=scale.Geometry, Height=dom_10)
duppt = RemoveDuplicatePts(Points=merge_3, Tolerance=0.01)
box_corners = BoxCorners(Box=boxrec)  # -> CornerA, CornerB, CornerC, CornerD, CornerE, CornerF, CornerG, CornerH
merge_4 = Merge(Data1=box_corners.CornerE, Data2=box_corners.CornerF, Data3=box_corners.CornerG, Data4=box_corners.CornerH)
anchor = Anchor(Point=merge_4, Strength=Slider(100000000, range=0..100000000))
spc = SolidPointCollide(Points=duppt, Solid=boxrec, Interior=False, Unidirectional=True, Strength=1)

# ---- group: Gravity
Z_4 = UnitZ(Factor=Slider(0.0001, range=0..1))
rev = Reverse(Vector=Z_4)
load = Load(Point=duppt, ForceVector=rev, Weighting=1)

# ----
_1_h = Slider(5000000, range=0..10000000)
_8_m = Slider(1000000, range=0..1000000)
_4_m = Slider(500000, range=0..1000000)
_50_s = Slider(100000, range=0..1000000)
_25_s = Slider(50000, range=0..1000000)
_10_s = Slider(20000, range=0..100000)
_5_s = Slider(10000, range=0..10000)
raise_by_power = RaiseByPower(A=threshold_factor_10_x)
raise_by_power_2 = RaiseByPower(A=tolerance_factor_10_x)
panel_12 = Panel(number_slider_2)
num_4 = Number(loop_start.Counter)

# ---- group: Web Strengh
number_slider_19 = Slider(100, range=0..200)
num_5 = Number(axialweb)
subtraction_2 = Subtraction(A=num_5, B=number_slider_19)
addition_3 = Addition(A=num_5, B=number_slider_19)

# ----
clip_1 = Python3Script(d1=subtraction_2, d2=addition_3)  # -> out, d1, d2; inputs d1: Int32, d2: Int32
# ---------- clip_1: Python ----------
"""Grasshopper Script"""
a = "Hello Python 3 in Grasshopper!"
print(a)
if d1 < 1:
    d1 = 1
    print("d1 = 1")

if d2 < 1:
    d2 = 1
    print("d2 = 1")
# ---------- end clip_1 ----------

# ---- group: Web Strengh (continued)
dom_11 = ConstructDomain(DomainStart=clip_1.d1, DomainEnd=clip_1.d2)

map_shrinkage_3 = MapShrinkage(curve=ln, curve_2=boundry, target=dom_11)

# ---- group: Domains
number_slider_20 = Slider(0, range=0..0.1)
num_6 = Number(matrix_shrinkage_factor_bottom)
num_7 = Number(matrix_shrinkage_factor_top)
subtraction_3 = Subtraction(A=num_7, B=number_slider_20)
addition_4 = Addition(A=num_7, B=number_slider_20)
dom_12 = ConstructDomain(DomainStart=subtraction_3, DomainEnd=addition_4)

subtraction_4 = Subtraction(A=num_6, B=number_slider_20)
addition_5 = Addition(A=num_6, B=number_slider_20)

dom_13 = ConstructDomain(DomainStart=subtraction_4, DomainEnd=addition_5)

# ---- group: Mat Shrinkage
map_shrinkage_4 = MapShrinkage(curve=mat_top, curve_2=boundry, target=dom_12)

map_shrinkage_5 = MapShrinkage(curve=mat_bot, curve_2=boundry, target=dom_13)

# ----
panel_13 = Panel(map_shrinkage_5)

# ---- group: Top
rodtopfiber = Rod(
    Polyline=shatter_2,
    LengthFactor=fiber_shrinkage_factor_top,
    AngleFactor=1,
    AxialStrength=axialfiber,
    BendStrength=bendingfiber)
rodtopmatrix = Rod(Polyline=shatter, LengthFactor=map_shrinkage_4, AngleFactor=1, AxialStrength=map_shrinkage, BendStrength=bendingmatrix)

# ---- group: Bottom
rodbottomfiber = Rod(
    Polyline=shatter_4,
    LengthFactor=fiber_shrinkage_factor_bottom,
    AngleFactor=1,
    AxialStrength=axialfiber,
    BendStrength=bendingfiber)
rodbottommatrix = Rod(
    Polyline=shatter_3,
    LengthFactor=map_shrinkage_5,
    AngleFactor=1,
    AxialStrength=map_shrinkage_2,
    BendStrength=bendingmatrix)

# ----
rodtoptobot = Rod(Polyline=ln, LengthFactor=1, AngleFactor=1, AxialStrength=map_shrinkage_3, BendStrength=bendingweb)
entwine = Entwine(
    Branch00=rodtopfiber,
    Branch01=rodtopmatrix,
    Branch02=rodtoptobot,
    Branch03=rodbottomfiber,
    Branch04=rodbottommatrix,
    Branch05=rodbotzipper,
    Branch06=graft(spc),
    Branch07=anchor,
    Branch08=load,
    FlattenInputs=True)

zombiesolver = ZombieSolver(GoalObjects=entwine, Threshold=raise_by_power, Tolerance=raise_by_power_2, MaxIterations=_8_m)  # -> I, V, O

# ---- group: Get Surface
geo = Geometry(zombiesolver.O)
unflatten = UnflattenTree(Tree=geo, Guide=entwine)
bang = ExplodeTree(Data=unflatten)  # -> Branch0, Branch1, Branch2, Branch3, Branch4, Branch5, Branch6, Branch7, Branch8
data = Data(bang.Branch1)
data_2 = Data(bang.Branch2)
data_3 = Data(bang.Branch3)
data_4 = Data(bang.Branch4)
data_5 = Data(bang.Branch0)

# ----
panel_14 = Panel(zombiesolver.I)

# ---- group: Get Surface / Get Sample Points
unflatten_2 = UnflattenTree(Tree=bang.Branch5, Guide=rodbotzipper)
trim = TrimTree(Tree=unflatten_2, Depth=1)
item = ListItem(List=trim, Index=0, Wrap=True)  # -> flatten(Item)
end = EndPoints(Curve=item)  # -> Start, End
sample_points = Data(end.Start)

# ---- group: Get Surface / Lofted Surface
partition = PartitionList(List=flatten(sample_points), Size=expr("x", surface_y_size))
intcrv = Interpolate(Vertices=partition, Degree=4, Periodic=False, KnotStyle=1)  # -> flatten(Curve), Length, Domain
loft = Loft(Curves=intcrv.Curve, Options={Adjust=False, Closed=False, LoftEnds=0, LoftSimp=0, LoftType=0, Rebuild=10, Refit=0.01})

# ----
srf_cp_2 = SurfaceClosestPoint(Point=sample_points, Surface=loft)  # -> Point, UVPoint, Distance
write_to_excel = WriteToExcel(
    hello=panel_12,
    counter=num_4,
    top_shrinkage=matrix_shrinkage_factor_top,
    thickness=thickness,
    bottom_shrinkage=matrix_shrinkage_factor_bottom,
    iteration=loop_start.Counter,
    rows=number_of_rows,
    cols=number_of_columns,
    u=surface_y_size,
    v=surface_x_size,
    angles=connect_angles,
    output_sample_pt=simplify(sample_points),
    imput_sample_pt=simplify(ptcenter),
    input_uv=simplify(srf_cp.UVPoint),
    srf=loft,
    output_uv=srf_cp_2.UVPoint)

loop_end = LoopEnd(port=loop_start.port, Exit=Toggle(False), Data=write_to_excel, TimeOutVal=0, pausedState=False, state="Output last")

rec_3 = DataRecorder(loop_end, DataLimit=-10, RecordData=True)
panel_15 = Panel(rec_3)

# ==== cluster RaiseByPower
A = ClusterInput()
multiplication = Multiplication(A=A, B=-1)
pow = Power(A=Slider(10, range=0..10), B=multiplication)
R = ClusterOutput(pow)

# ==== cluster WriteToExcel
rows = ClusterInput()
cols = ClusterInput()
u = ClusterInput()
v = ClusterInput()
angles = ClusterInput()
imput_sample_pt = ClusterInput()
output_sample_pt = ClusterInput()
input_uv = ClusterInput()
output_uv = ClusterInput()
division = Division(A=u, B=rows)
division_2 = Division(A=v, B=cols)

output_sample_pt_2 = Point(simplify(output_sample_pt))
imput_sample_pt_2 = Point(simplify(imput_sample_pt))
input_uv_2 = Data(input_uv)
output_uv_2 = Data(output_uv)

input_angles_and_borders = Python3Script(rows=rows, cols=cols, u=u, v=v, angles=angles, patch_size_u=division, patch_size_v=division_2)  # -> out, angles_output, border_output, pt_num; inputs rows: Int32, cols: Int32, u: Int32, v: Int32, angles: list of Int32, patch_size_u: Int32, patch_size_v: Int32
# ---------- input_angles_and_borders: Python ----------
# """Grasshopper Script"""
# import System
# import Rhino
# import Grasshopper
# import rhinoscriptsyntax as rs

# angles_output=[]
# pt_num=u*v
# angle=0
# x=1


# for col in range(cols):
#     x = patch_size
#     for j in range(x):
#         for row in range(rows):
#             for i in range(x):
#                 angles_output.append(angles[row+(col*rows)])



# #print("border: " + str(border_output) + str(len(border_output)))
# print("angles: " + str(angles_output)+ str(len(angles_output)))


"""Grasshopper Script"""
import System
import Rhino
import Grasshopper
import rhinoscriptsyntax as rs

angles_output = []
pt_num = u * v
angle = 0

for col in range(cols):
    for j in range(patch_size_v):
        for row in range(rows):
            for i in range(patch_size_u):
                angles_output.append(angles[row + (col * rows)])
                
print("angles: " + str(angles_output) + str(len(angles_output)))
# ---------- end input_angles_and_borders ----------
flatten = FlattenTree(Tree=output_sample_pt_2, Path="{0}")
flatten_2 = FlattenTree(Tree=imput_sample_pt_2, Path="{0}")

# ---- group: check that input and output points match
number_slider = Slider(0, range=0..336)
item = ListItem(List=flatten, Index=number_slider, Wrap=True)
item_2 = ListItem(List=flatten_2, Index=number_slider, Wrap=True)

# ----
srf = ClusterInput()

# ---- group: Output Surface
srf_2 = Surface(srf)

# ---- group: Rebuild
rebuild_surface = RebuildSurface(Surface=srf_2, CountU=Slider(5, range=0..100), CountV=Slider(8, range=0..100))

# ---- group: Fiber Direction Bottom
addition = Addition(A=input_angles_and_borders.angles_output, B=Slider(90, range=0..100))

# ----
# Analyze Simulation Result
bottom_shrinkage = ClusterInput()  # Bottom Shrinkage
top_shrinkage = ClusterInput()
thickness = ClusterInput()  # Thickness

fiber_direction_top = Integer(input_angles_and_borders.angles_output)
border = Integer(input_angles_and_borders.border_output)

# ---- group: point curvature
curvature = PrincipalCurvature(Surface=rebuild_surface, Point=flatten(output_uv_2))  # -> simplify(graft(Frame)), simplify(graft(Maximum)), simplify(graft(Minimum)), simplify(graft(MaxDirection)), simplify(graft(MinDirection))

# ---- group: movement vector
vec2pt = Vector2Pt(PointA=flatten_2, PointB=flatten, Unitize=False)  # -> simplify(graft(Vector)), simplify(graft(Length))

# ---- group: point location
pdecon = Deconstruct(Point=flatten)  # -> simplify(graft(XComponent)), simplify(graft(YComponent)), simplify(graft(ZComponent))

# ---- group: Added Values
evalsrf = EvaluateSurface(Surface=srf_2, Point=output_uv_2)  # -> Point, simplify(graft(Normal)), simplify(graft(UDirection)), simplify(graft(VDirection)), Frame
pt = Point(evalsrf.Point)
vdisex = VectorDisplayEx(Point=flatten(pt), Vector=flatten(evalsrf.VDirection), Colour=flatten(evalsrf.Normal), Width=2)
panel = Panel("Normal Vector")
panel_2 = Panel("U Vector")
panel_3 = Panel("V Vector")

# ----
num_of_points = Number(input_angles_and_borders.pt_num)
dup = DuplicateData(Data=bottom_shrinkage, Number=num_of_points, Order=True)
dup_2 = DuplicateData(Data=top_shrinkage, Number=num_of_points, Order=True)
dup_3 = DuplicateData(Data=thickness, Number=num_of_points, Order=True)

# ---- group: view curvature
number_slider_2 = Slider(12, range=0..100)  # disabled
multiplication = Multiplication(A=curvature.Maximum, B=number_slider_2)  # disabled
amp = Amplitude(Vector=curvature.MaxDirection, Amplitude=multiplication)  # disabled
vdisex_2 = VectorDisplayEx(Point=flatten(output_sample_pt_2), Vector=flatten(amp), Colour=flatten(curvature.MaxDirection), Width=2)  # disabled

# ----
iteration = ClusterInput()
uv = Point(flatten(input_uv_2))
iteration_2 = Integer(iteration)
vdisex_3 = VectorDisplayEx(Point=flatten, Vector=flatten(curvature.MaxDirection), Colour=flatten(curvature.MaxDirection), Width=2)
crv = ClusterInput()

# ---- group: time based seed
second = Trigger(Interval=30000, TimerInterval=30000, Target=time)
time = Time("Now")
panel_4 = Panel(time)
time_to_number = GhPythonScript(time=panel_4)  # -> seed
# ---------- time_to_number: Python ----------
__author__ = "user"
__version__ = "2023.11.15"

import rhinoscriptsyntax as rs
import re


time = time[-10:]
time = re.sub(r'[^0-9]', '', time)
seed = int(time)
print(seed)
# ---------- end time_to_number ----------

# ----
hello = ClusterInput()  # hello
panel_5 = Panel(hello)

merge = Merge(
    Data1=vec2pt.Vector,
    Data2=vec2pt.Length,
    Data3=curvature.Maximum,
    Data4=curvature.Minimum,
    Data5=curvature.MaxDirection,
    Data6=curvature.MinDirection,
    Data7=pdecon.XComponent,
    Data8=pdecon.YComponent,
    Data9=pdecon.ZComponent,
    Data10=evalsrf.Normal,
    Data11=evalsrf.UDirection,
    Data12=evalsrf.VDirection)  # -> simplify(Result)
merge_2 = Merge(
    Data1="Movement Vector Direction",
    Data2="Movement Vector Length",
    Data3="Max Curvature Length",
    Data4="Min Curvature Length",
    Data5="Max Curvature Direction",
    Data6="Min Curvature Direction",
    Data7="Location X",
    Data8="Location Y",
    Data9="Location Z",
    Data10=panel,
    Data11=panel_2,
    Data12=panel_3)  # -> simplify(Result)
# Write Output to Excel
concat = Concatenate(FragmentA="C:\DATASET\Dataset_Output_", FragmentB=panel_5, FragmentC=".xlsx")
path = FilePath(concat)
button = Button()
flip = FlipMatrix(Data=merge)
concat_2 = Concatenate(FragmentA="Iteration ", FragmentB=iteration_2)
excelwrite = ExcelWrite(
    WriteExcelData=Toggle(True),
    WorkbookPath=path,
    WorksheetName=concat_2,
    ColumnHeadings=merge_2,
    Data=flip,
    ClearSheet=Toggle(True))

panel_6 = Panel(excelwrite)
rec = DataRecorder(concat_2, DataLimit=-10, RecordData=True)
len = TextLength(Text=panel_6)
panel_7 = Panel(rec)
dom = ConstructDomain(DomainStart="-100", DomainEnd="100")
counter = ClusterInput()  # Counter for seed randomality purposes
random = Random(Range=Domain(0, 30), Number=1, Seed=time_to_number)

panel_8 = Panel("Location Z")
panel_9 = Panel("Location X")
panel_10 = Panel("Location Y")
merge_3 = Merge(
    Data1=simplify(graft(fiber_direction_top)),
    Data2=simplify(graft(dup_2)),
    Data3=simplify(graft(dup_3)),
    Data4=simplify(graft(addition)),
    Data5=simplify(graft(dup)),
    Data6=simplify(graft(uv)))  # -> simplify(Result)
merge_4 = Merge(Data1="Top Angle", Data2="Top Shrinkage", Data3="Mid Width", Data4="Bottom Angle", Data5="Bottom Shrinkage", Data6="UV")  # -> simplify(Result)
flip_2 = FlipMatrix(Data=merge_3)
concat_3 = Concatenate(FragmentA="Iteration ", FragmentB=iteration_2)

concat_4 = Concatenate(FragmentA="C:\DATASET\Dataset_Input_", FragmentB=panel_5, FragmentC=".xlsx")

path_2 = FilePath(concat_4)
excelwrite_2 = ExcelWrite(
    WriteExcelData=Toggle(True),
    WorkbookPath=path_2,
    WorksheetName=concat_3,
    ColumnHeadings=merge_4,
    Data=flip_2,
    ClearSheet=Toggle(True))

panel_11 = Panel(merge_3)
panel_12 = Panel(excelwrite_2)
rec_2 = DataRecorder(concat_3, DataLimit=-10, RecordData=True)
len_2 = TextLength(Text=panel_12)
panel_13 = Panel(rec_2)

# ---- group: baking
multiplication_2 = Multiplication(A=Slider(20, range=0..100), B=iteration_2)
X = UnitX(Factor=multiplication_2)
toggle = BooleanToggle(True)

# ----
crv_2 = Curve(flatten(crv))
geometry_to_bake = Geometry(crv_2)

# ---- group: baking (continued)
move = Move(Geometry=geometry_to_bake, Motion=X)  # -> Geometry, Transform

# ----
bake_attr = BakeAttributes(Geometry=move.Geometry, Bake=toggle)  # disabled

# ---- group: replace the seed by clock
random_2 = Random(Range=Domain(0, 10000), Number=1, Seed=time_to_number)
item_3 = ListItem(List=move.Geometry, Index=random_2, Wrap=True)

# ----
len_3 = Length(Curve=item_3)
ma = MassAddition(Input=flatten([len_3, len_2, len, time_to_number]))  # -> Result, PartialResults
division_3 = Division(A=ma.Result, B=random)

# ---- group: replace the seed by clock
concat_5 = Concatenate(FragmentA=item_3, FragmentB=division_3, FragmentC=panel_6, FragmentD=panel_12)
guid_to_number = GhPythonScript(guid=concat_5)  # -> seed
# ---------- guid_to_number: Python ----------
__author__ = "user"
__version__ = "2023.11.15"

import rhinoscriptsyntax as rs
import re
import math



seed = re.sub(r'[^0-9]', '', guid)
seed = int(seed)
seed = math.sqrt(seed)/1000000000000
print(seed)
# ---------- end guid_to_number ----------

# ---- group: ensure of seed
dom_2 = ConstructDomain(DomainStart="-100000", DomainEnd="100000")
random_3 = Random(Domain=dom_2, Num="1", Seed=time_to_number, Sort=0)  # -> Int, D
random_4 = Random(Range=dom, Number=1, Seed=counter)
addition_2 = Addition(A=guid_to_number, B=random_3.D)
multiplication_3 = Multiplication(A=addition_2, B=random_4)

# ----
seed = ClusterOutput(multiplication_3)

# ==== cluster GateCluster
G = ClusterInput()
_0 = ClusterInput()
_1 = ClusterInput()
G_2 = ClusterInput()
_0_2 = ClusterInput()
_1_2 = ClusterInput()
G_3 = ClusterInput()
_0_3 = ClusterInput()
_1_3 = ClusterInput()
G_4 = ClusterInput()
_0_4 = ClusterInput()
G_5 = ClusterInput()
_0_5 = ClusterInput()
_1_4 = ClusterInput()
G_6 = ClusterInput()
_0_6 = ClusterInput()
_1_5 = ClusterInput()

# ---- group: Adaptive or Pixelization Gate / Shape's Dimensions
num = Number(1)
filter = StreamFilter(Gate=G_3, Stream0=_0_3, Stream1=_1_3)
filter_2 = StreamFilter(Gate=G_4, Stream0=_0_4, Stream1=num)

# ---- group: Adaptive or Pixelization Gate
filter_top = StreamFilter(Gate=G, Stream0=flatten(_0), Stream1=_1)
filter_bot = StreamFilter(Gate=G_2, Stream0=flatten(_0_2), Stream1=_1_2)
filter_srf = StreamFilter(Gate=G_5, Stream0=_0_5, Stream1=_1_4)
filter_patch_curves = StreamFilter(Gate=G_6, Stream0=_0_6, Stream1=_1_5)

# ----
s_0 = ClusterOutput(filter_top)
s_0_2 = ClusterOutput(filter_bot)
s_0_3 = ClusterOutput(filter)
s_0_4 = ClusterOutput(filter_2)
s_0_5 = ClusterOutput(filter_srf)
s_0_6 = ClusterOutput(filter_patch_curves)

# ==== cluster MapShrinkage

# ---- group: To boundry
curve = ClusterInput()
curve_middle = CurveMiddle(Curve=curve)
curve_2 = ClusterInput()
curve_closest_point = CurveClosestPoint(Point=curve_middle, Curve=curve_2)  # -> Point, Parameter, Distance
multiplication = Multiplication(A=curve_closest_point.Distance, B=curve_closest_point.Distance)
sqrt = SquareRoot(Value=curve_closest_point.Distance)

# ---- group: To corners
control_polygon = ControlPolygon(Curve=curve_2)  # -> Polygon, Points
closest_point = ClosestPoint(Point=curve_middle, Cloud=control_polygon.Points)  # -> ClosestPoint, CPIndex, Distance
multiplication_2 = Multiplication(A=closest_point.Distance, B=closest_point.Distance)
number = Number(multiplication_2)

# ----
number_2 = Number(curve_closest_point.Distance)
subtraction = Subtraction(A=number_2)
text_tag = TextTag(Location=curve_middle, Text=subtraction)
bounds = Bounds(Numbers=flatten(subtraction))
target = ClusterInput()
remap_numbers = RemapNumbers(Value=subtraction, Source=bounds, Target=target)  # -> Mapped, Clipped
mapped = ClusterOutput(remap_numbers.Mapped)
